# Dynamo graph testing_01.dyn (Dynamo 1.3.0.875)

file_path = Filename("meshes\saddle.obj")
compasNetworkFromObj = Compas.Dynamo.Datastructures.CompasNetwork.CompasNetworkFromObj(file_path)
integer_slider = IntegerSlider(50, range=0..100 step 1)
boolean = BoolSelector(true)
smooth = Compas.Dynamo.Datastructures.CompasNetwork.Smooth(compasNetworkFromObj, integer_slider, boolean)
getFloatFrames = Compas.Dynamo.Datastructures.CompasNetwork.GetFloatFrames(smooth)
watch = Watch(getFloatFrames)
getFrames = Compas.Dynamo.Datastructures.CompasNetwork.GetFrames(smooth)
watch_2 = Watch(getFrames)
